# Grasshopper definition csvversion.gh (Grasshopper 1.0.7)

panel = Panel("C:\_Python\GML-Grasshopper-connection\srf_in_crv_id.csv")  # disabled
panel_2 = Panel("C:\_Python\GML-Grasshopper-connection\srf_ex_crv_id.csv")  # disabled
panel_3 = Panel("C:\_Python\GML-Grasshopper-connection\points_id.csv")  # disabled
panel_4 = Panel("C:\_Python\GML-Grasshopper-connection\points_y.csv")  # disabled
panel_5 = Panel("C:\_Python\GML-Grasshopper-connection\points_x.csv")  # disabled
panel_6 = Panel("C:\_Python\GML-Grasshopper-connection\srf_id.csv")  # disabled
file = ReadFile(F=panel_3, PerLineParse=True)  # -> C; disabled
#   port F: Uri of file to read
# ---------- file: VB line parser ----------
    action = GH_LineParserAction.Include
    Return line

    'Parse the line and return some data that represents the line.
    'If the line cannot be parsed, you can return Nothing and
    'assign a different action.
    'The default implementation is to just return the line itself.
    'If you return types that implement IGH_Goo, this component
    'will work substantially faster.
# ---------- end file ----------
file_2 = ReadFile(F="C:\_Python\GML-Grasshopper-connection\area_建ぺい率.csv", PerLineParse=True)  # -> C; same code as file
file_3 = ReadFile(F="C:\_Python\GML-Grasshopper-connection\area_容積率.csv", PerLineParse=True)  # -> C; same code as file
file_4 = ReadFile(F="C:\_Python\GML-Grasshopper-connection\area_用途地域.csv", PerLineParse=True)  # -> C; same code as file
file_5 = ReadFile(F=panel_4, PerLineParse=True)  # -> C; disabled; same code as file
panel_7 = Panel(",")  # disabled
file_6 = ReadFile(F=panel_5, PerLineParse=True)  # -> C; disabled; same code as file
file_7 = ReadFile(F=panel_2, PerLineParse=True)  # -> C; disabled; same code as file
file_8 = ReadFile(F=panel, PerLineParse=True)  # -> C; disabled; same code as file
file_9 = ReadFile(F=panel_6, PerLineParse=True)  # -> C; disabled; same code as file
panel_8 = Panel(",")  # disabled
panel_9 = Panel(",")  # disabled
panel_10 = Panel(",")  # disabled
panel_11 = Panel(",")  # disabled
panel_12 = Panel(",")  # disabled
split = TextSplit(Text=file_2, Separators=",")
split_2 = TextSplit(Text=file_3, Separators=",")
split_3 = TextSplit(Text=file_4, Separators=",")
split_4 = TextSplit(Text=file, Separators=panel_7)  # disabled
split_5 = TextSplit(Text=file_9, Separators=panel_11)  # disabled
split_6 = TextSplit(Text=file_5, Separators=panel_8)  # disabled
split_7 = TextSplit(Text=file_6, Separators=panel_9)  # disabled
split_8 = TextSplit(Text=file_7, Separators=panel_10)  # disabled
split_9 = TextSplit(Text=file_8, Separators=panel_12)  # disabled
panel_13 = Panel("1000")  # disabled
panel_14 = Panel("1000")  # disabled
panel_15 = Panel("0")  # disabled
multiplication = Multiplication(A=split_6, B=panel_13)  # disabled
multiplication_2 = Multiplication(A=split_7, B=panel_14)  # disabled
pt = ConstructPoint(XCoordinate=multiplication_2, YCoordinate=multiplication, ZCoordinate=panel_15)  # disabled
panel_16 = Panel("1")  # disabled
pline = PolyLine(Vertices=pt, Closed=panel_16)  # disabled
keysearch = KeyValueSearch(Keys=flatten(split_4), Values=flatten(pline), Search=split_9)  # disabled
keysearch_2 = KeyValueSearch(Keys=flatten(split_4), Values=flatten(pline), Search=split_8)  # disabled
swatch = ColourSwatch(SwatchColor=RGB(93, 255, 0))  # disabled
swatch_2 = ColourSwatch(SwatchColor=RGB(255, 0, 0))  # disabled
preview = CustomPreview(Geometry=keysearch, Material=swatch)  # disabled
preview_2 = CustomPreview(Geometry=keysearch_2, Material=swatch_2)  # disabled
merge = Merge(Data1=keysearch_2, Data2=keysearch)  # disabled
gradient = Gradient(
    LowerLimit=0,
    UpperLimit=1,
    stops=[0: RGB(243, 57, 0), 0.1: RGB(236, 27, 60), 0.2: RGB(210, 0, 118), 0.3: RGB(103, 0, 120), 0.4: RGB(39, 72, 161), 0.5: RGB(1, 192, 229), 0.6: RGB(18, 178, 90), 0.7: RGB(79, 186, 8), 0.8: RGB(220, 237, 32), 0.9: RGB(247, 159, 20), 1: RGB(243, 57, 0)])  # disabled
boundary = BoundarySurfaces(Edges=merge)  # disabled
area = Area(Geometry=boundary)  # -> Area, flatten(Centroid); disabled
tag = TextTag(Location=area.Centroid, Text=split_5)  # disabled
