# Grasshopper definition ghpythontest.gh (Grasshopper 1.0.7)
# plug-ins: GH_CPython

number_slider = Slider(9, range=0..10)
panel = Panel("3")
gh_cpython = GH_CPython(input=number_slider, x="5", y=number_slider)  # -> output, a, b, test_x, test_y; inputs input: list, x: list, y: list
#   port input: [required] - [type = int] - [default = None] Descripe your input here * bullet point. * bullet point
#   port output: indicate your output description here. refers to a new line.
# ---------- gh_cpython: Python ----------
# -*- coding: utf-8 -*-
""" 
Python Script
Created on  Sunday December 2019 09:08:26 
@author:  novuf 

[desc]
Description of the plugin Here
Write here any thing... 
[/desc]

"""



ppp = 10 * _input * y

print(ppp)

ppp = [["abc", "ijk", "3333"], ["abc", "ijk", "3333"]]

ccc = []

for i in ppp:
    ccc.append(",".join(i))

qqq = "+".join(ccc)

a = qqq
# ---------- end gh_cpython ----------
gh_cpython_2 = GH_CPython(x="5", y=number_slider)  # -> a, b; inputs x: list, y: list
# ---------- gh_cpython_2: Python ----------
# -*- coding: utf-8 -*-
""" 
Python Script
Created on  Sunday December 2019 09:08:26 
@author:  novuf 

[desc]
Description of the plugin Here
Write here any thing... 
[/desc]

"""


def join_num(listitem):
    list_1 = []
    for i in listitem:
        list_1.append(",".join(i))
    flatten = "+".join(list_1)
    return flatten
    

ppp = [["321", "379", "543"], ["34", "453", "654"]]

ttt = [["241", "67", "343"], ["765", "90", "400"]]

a = join_num(ppp)
b = join_num(ttt)
# ---------- end gh_cpython_2 ----------

split = TextSplit(Text=gh_cpython_2.a, Separators="+")
panel_2 = Panel(split)
split_2 = TextSplit(Text=split, Separators=",")
panel_3 = Panel(split_2)

rep = ReplaceText(Text=gh_cpython.test_x, Find="'", RecursiveReplace=False)
rep_2 = ReplaceText(Text=gh_cpython.test_y, Find="'", RecursiveReplace=False)
split_3 = TextSplit(Text=gh_cpython_2.b, Separators="+")
rep_3 = ReplaceText(Text=rep, Find=" ", RecursiveReplace=False)
rep_4 = ReplaceText(Text=rep_2, Find=" ", RecursiveReplace=False)
panel_4 = Panel(split_3)
pt = ConstructPoint(XCoordinate=rep_3, YCoordinate=rep_4, ZCoordinate=0)
pline = PolyLine(Vertices=pt, Closed=False)
srf = Surface(pline)
split_4 = TextSplit(Text=panel_4, Separators=",")
panel_5 = Panel(split_4)
pt_2 = ConstructPoint(XCoordinate=split_2, YCoordinate=panel_5, ZCoordinate=0)
pline_2 = PolyLine(Vertices=pt_2, Closed=Toggle(True))
srf_2 = Surface(pline_2)
